# Grasshopper definition speckle-get-stream.gh (Grasshopper 1.0.7)
# plug-ins: Speckle 2

panel = Panel("https://app.speckle.systems/projects/0a088653cb/models/d85f40f950")
receive = Receive(
    Stream=panel,
    AutoReceive=False,
    CurrentComponentState="up_to_date",
    ExpandOutput=True,
    LastInfoMessage="Laszlo Andrasi @ 10/26/2024 18:26:51: Sent 7 objects from Revit2023. (id:d3e2f5dd5b)",
    ReceiveOnOpen=True,
    ReceivedCommitId="d3e2f5dd5b",
    StreamWrapper="https://app.speckle.systems/projects/0a088653cb/models/revit/exchange/walls&floors",
    selectedKitName="Objects")  # -> Info, CollectionType, Elements, Info_2, Name, Types
panel_2 = Panel(receive.Elements)
list_length = ListLength(List=receive.Elements)
panel_3 = Panel(list_length)
